# Dynamo graph csv.dyn (Dynamo 2.13.0.2363)

file_path = Filename("C:\Users\vykru\repos\Hexel\SpacePlanning\Notebooks\Csv.csv")
readText = FileSystem.ReadText(file=file_path)
code_block = CodeBlock(st=readText)
# ---------- code_block.designscript (3 lines) ----------
a = List.TakeEveryNthItem(String.ToNumber(String.TrimWhitespace(String.Split(st,["(",")",","]))),2,[1,0]);
b = Polygon.ByPoints(Point.ByCoordinates([0,1,1,0,-1,-1],[1.5,0.5,-0.5,-1.5,-0.5,0.5])).Transform(CoordinateSystem.ByOrigin(List.FirstItem(a),List.LastItem(a)));
c = List.Chop(b,6);
# ----------------------------------------
code_block_2 = CodeBlock(d=code_block.c) { d[0]; }
code_block_3 = CodeBlock(d=code_block.c) { d[1]; }
